% Simulink data dictionary Data.sldd

InBus = Simulink.Bus()
  a: double
  a1: double
  a2: double

OutBus = Simulink.Bus()
  a: double
  a1: double
  a2: double

Params = Simulink.Bus()
  p: double
  p1: double
  p2: double

PlantOut = Simulink.Bus()
  a_p: double
  a1_p: double
  a2_p: double

PlantIn = Simulink.Bus()
  a_p: double
  a1_p: double
  a2_p: double

ExtParams = Simulink.Bus()
  p_ext: double
  p1_ext: double
  p2_ext: double

toCtrl = Simulink.Bus()
  toCtrl1: Bus: InBus
  toCtrl2: Bus: InBus
  params: Bus: Params

topLevelIn = Simulink.Bus()
  fromPlant: Bus: PlantOut
  fromOtherLane: Bus: toCtrl
  param: Bus: ExtParams

DspOutputs = Simulink.Bus()
  ctrlDsp1: Bus: OutBus
  ctrlDsp2: Bus: OutBus

LanePlantIn = Simulink.Bus()
  pOut: Bus: PlantIn
  pOut1: Bus: PlantIn

PlantInBundle = Simulink.Bus()
  lane1: Bus: LanePlantIn
  lane2: Bus: LanePlantIn